# Grasshopper definition nazwa_testowa.gh (Grasshopper 1.0.8)

geometry = Geometry()

unit_z = UnitZ(Factor=Slider(13, range=0..100))
# MOVE TEST
move = Move(Geometry=geometry, Motion=unit_z)  # -> Geometry, Transform

geometry_2 = Geometry(move.Geometry)
